# Grasshopper definition example.gh (Grasshopper 1.0.8)

panel = Panel("""Bottom
Top""")
panel_2 = Panel("""Bottom
Top""")
brep = Brep(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)
brep_2 = Brep(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)
brep_3 = Brep(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)
brep_4 = Brep(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)
item = ListItem(List=panel_2, Index=0, Wrap=True)  # -> Item, Item1
merge = Merge(Data1=brep_3, Data2=brep_4)
unload = Python3Script(unload=Button())  # -> out, a
# ---------- unload: Python ----------
import sys
import compas
from compas_rhino import unload_modules

print(compas.__version__)

unload_modules('raystrack')
# ---------- end unload ----------
raystrackmatrix = Python3Script(
    breps=merge,
    names=panel,
    samples=Slider(256, range=0..512),
    rays=Slider(512, range=0..512),
    seed=Slider(10, range=0..10),
    use_bvh=Toggle(False),
    flip_faces=Toggle(False),
    max_iters=Slider(100, range=0..100),
    tol=Slider(1e-06, range=0..1),
    run=Toggle(False))  # -> out, meshes, vf_matrix; inputs breps: list of Brep, names: list, tol: Double
# ---------- raystrackmatrix: Python ----------
import sys
import Rhino.Geometry as rg
import scriptcontext as sc
import System
import numpy as np
from Grasshopper.Kernel import GH_RuntimeMessageLevel as RML
from raystrack.main import view_factor_matrix

def error(msg):
    ghenv.Component.AddRuntimeMessage(RML.Error, msg)
    raise ValueError(msg)

def warn(msg):
    ghenv.Component.AddRuntimeMessage(RML.Warning, msg)

def convert_guids_to_breps(face_geos):
    new_brep = []
    for geoId in face_geos:
        rhino_obj = sc.doc.Objects.FindId(geoId)
        if rhino_obj is None:
            print("Could not find object with ID:", geoId)
            continue
        geometry = rhino_obj.Geometry
        if isinstance(geometry, rg.Brep):
            new_brep.append(geometry)
        else:
            try:
                if hasattr(geometry, 'ToBrep'):
                    brep = geometry.ToBrep()
                    if brep is not None:
                        new_brep.append(brep)
            except:
                print("Could not convert geometry", geoId, "to Brep")
    return new_brep

def geometry_to_mesh(geo, mp=None):
    mp = mp or rg.MeshingParameters.Default
    if isinstance(geo, rg.Mesh):
        msh = geo.DuplicateMesh()
    elif isinstance(geo, rg.Brep):
        mlist = rg.Mesh.CreateFromBrep(geo, mp)
        if not mlist:
            error("Meshing failed for Brep.")
        msh = rg.Mesh()
        for m in mlist:
            msh.Append(m)
    elif isinstance(geo, (rg.Surface, rg.Extrusion)):
        mlist = rg.Mesh.CreateFromBrep(geo.ToBrep(), mp)
        if not mlist:
            error("Meshing failed for Surface/Extrusion.")
        msh = rg.Mesh()
        for m in mlist:
            msh.Append(m)
    elif hasattr(rg, "SubD") and isinstance(geo, rg.SubD):
        msh = rg.SubD.CreateSubDMesh(geo, mp)
    else:
        error("Unsupported geometry type.")
    msh.Faces.ConvertQuadsToTriangles()
    msh.UnifyNormals()
    msh.Normals.ComputeNormals()
    msh.Compact()
    return msh

def rhino_mesh_to_arrays(msh):
    if not msh.IsValid or msh.Vertices.Count == 0 or msh.Faces.Count == 0:
        error("Empty or invalid mesh.")
    verts = np.asarray([[v.X, v.Y, v.Z] for v in msh.Vertices], dtype=np.float32)
    faces = np.asarray([[f.A, f.B, f.C] for f in msh.Faces], dtype=np.int32)
    return verts, faces

if not _breps or len(_breps) == 0:
    error("No geometry in _breps.")
if _names is None:
    error("_names is required.")
if len(_names) != len(_breps):
    error("_names length mismatch.")

_seen = set()
for n in _names:
    if not isinstance(n, str) or n.strip() == "":
        error("_names entries must be non-empty strings.")
    if n in _seen:
        error("Duplicate name in _names.")
    _seen.add(n)

_samples = int(_samples) if _samples is not None else 256
if _samples <= 0:
    error("_samples must be positive.")
_rays = int(_rays) if _rays is not None else 256
if _rays <= 0:
    error("_rays must be positive.")
_seed = int(_seed) if _seed is not None else 0

if _gpu_threads is not None:
    try:
        _gpu_threads = int(_gpu_threads)
        if _gpu_threads <= 0:
            error("_gpu_threads must be positive.")
    except:
        error("_gpu_threads must be an integer.")
_use_bvh = bool(_use_bvh) if _use_bvh is not None else False

_flip_faces = bool(_flip_faces) if _flip_faces is not None else False

_max_iters = int(_max_iters) if _max_iters is not None else 1

_tol = float(_tol) if _tol is not None else 1e-5

_reciprocity = _reciprocity if _reciprocity is not None else False

meshes = []
meshes_np = []
for obj, name in zip(_breps, _names):
    if obj is None:
        warn("Null geometry skipped.")
        continue
    if isinstance(obj, (System.Guid, str)):
        try:
            gid = System.Guid(obj) if isinstance(obj, str) else obj
        except:
            error("Invalid GUID input.")
        breps = convert_guids_to_breps([gid])
        if not breps:
            error("GUID conversion returned no Brep.")
        msh = geometry_to_mesh(breps[0])
    else:
        msh = geometry_to_mesh(obj)
    V, F = rhino_mesh_to_arrays(msh)
    meshes.append(msh)
    meshes_np.append((name, V, F))

if len(meshes_np) < 2:
    warn("Need at least two surfaces.")

if run:
    vf_result = view_factor_matrix(
        meshes_np,
        samples=_samples,
        rays=_rays,
        seed=_seed,
        gpu_threads=_gpu_threads,
        use_bvh=_use_bvh,
        flip_faces=_flip_faces,
        max_iters=_max_iters,
        tol=_tol

    )
    vf_matrix = [vf_result]
# ---------- end raystrackmatrix ----------
raystrack = Python3Script(
    sender=brep,
    sender_name=item.Item,
    receiver=brep_2,
    receiver_name=item.Item1,
    names=panel_2,
    samples=Slider(16, range=0..512),
    rays=Slider(128, range=0..512),
    seed=Slider(4, range=0..10),
    use_bvh=Toggle(False),
    flip_faces=Toggle(False),
    max_iters=Slider(100, range=0..100),
    tol=Slider(1e-06, range=0..0.0001),
    run=Toggle(False))  # -> out, sender_meshes, receiver_meshes, vf_matrix; inputs sender: list of Brep, sender_name: list, receiver: list, receiver_name: list, names: list
# ---------- raystrack: Python ----------
import sys
import Rhino.Geometry as rg
import scriptcontext as sc
import System
import numpy as np
from Grasshopper.Kernel import GH_RuntimeMessageLevel as RML
from raystrack.main import view_factor

def error(msg):
    ghenv.Component.AddRuntimeMessage(RML.Error, msg)
    raise ValueError(msg)

def warn(msg):
    ghenv.Component.AddRuntimeMessage(RML.Warning, msg)

def convert_guids_to_breps(face_geos):
    new_brep = []
    for geoId in face_geos:
        rhino_obj = sc.doc.Objects.FindId(geoId)
        if rhino_obj is None:
            print("Could not find object with ID:", geoId)
            continue
        geometry = rhino_obj.Geometry
        if isinstance(geometry, rg.Brep):
            new_brep.append(geometry)
        else:
            try:
                if hasattr(geometry, 'ToBrep'):
                    brep = geometry.ToBrep()
                    if brep is not None:
                        new_brep.append(brep)
            except:
                print("Could not convert geometry", geoId, "to Brep")
    return new_brep

def geometry_to_mesh(geo, mp=None):
    mp = mp or rg.MeshingParameters.Default
    if isinstance(geo, rg.Mesh):
        msh = geo.DuplicateMesh()
    elif isinstance(geo, rg.Brep):
        mlist = rg.Mesh.CreateFromBrep(geo, mp)
        if not mlist:
            error("Meshing failed for Brep.")
        msh = rg.Mesh()
        for m in mlist:
            msh.Append(m)
    elif isinstance(geo, (rg.Surface, rg.Extrusion)):
        mlist = rg.Mesh.CreateFromBrep(geo.ToBrep(), mp)
        if not mlist:
            error("Meshing failed for Surface/Extrusion.")
        msh = rg.Mesh()
        for m in mlist:
            msh.Append(m)
    elif hasattr(rg, "SubD") and isinstance(geo, rg.SubD):
        msh = rg.SubD.CreateSubDMesh(geo, mp)
    else:
        error("Unsupported geometry type.")
    msh.Faces.ConvertQuadsToTriangles()
    msh.UnifyNormals()
    msh.Normals.ComputeNormals()
    msh.Compact()
    return msh

def rhino_mesh_to_arrays(msh):
    if not msh.IsValid or msh.Vertices.Count == 0 or msh.Faces.Count == 0:
        error("Empty or invalid mesh.")
    verts = np.asarray([[v.X, v.Y, v.Z] for v in msh.Vertices], dtype=np.float32)
    faces = np.asarray([[f.A, f.B, f.C] for f in msh.Faces], dtype=np.int32)
    return verts, faces

if not _sender or len(_sender) == 0:
    error("No geometry in _sender.")
if _sender_name is None:
    error("_sender_name is required.")
if len(_sender_name) != len(_sender):
    error("_sender_name length mismatch.")

_seen = set()
for n in _sender_name:
    if not isinstance(n, str) or n.strip() == "":
        error("_sender_name entries must be non-empty strings.")
    if n in _seen:
        error("Duplicate name in _sender_name.")
    _seen.add(n)

if not _receiver or len(_receiver) == 0:
    error("No geometry in _receiver.")
if _receiver_name is None:
    error("_receiver_name is required.")
if len(_receiver_name) != len(_receiver):
    error("_receiver_name length mismatch.")

_seen = set()
for n in _receiver_name:
    if not isinstance(n, str) or n.strip() == "":
        error("_receiver_name entries must be non-empty strings.")
    if n in _seen:
        error("Duplicate name in _receiver_name.")
    _seen.add(n)

_samples = int(_samples) if _samples is not None else 256
if _samples <= 0:
    error("_samples must be positive.")
_rays = int(_rays) if _rays is not None else 256
if _rays <= 0:
    error("_rays must be positive.")
_seed = int(_seed) if _seed is not None else 0

if _gpu_threads is not None:
    try:
        _gpu_threads = int(_gpu_threads)
        if _gpu_threads <= 0:
            error("_gpu_threads must be positive.")
    except:
        error("_gpu_threads must be an integer.")
_use_bvh = bool(_use_bvh) if _use_bvh is not None else False

_flip_faces = bool(_flip_faces) if _flip_faces is not None else False

_max_iters = int(_max_iters) if _max_iters is not None else 1

_tol = int(_tol) if _tol is not None else 1e-5

sender_meshes = []
sender_meshes_np = []
for obj, name in zip(_sender, _sender_name):
    if obj is None:
        warn("Null geometry skipped.")
        continue
    if isinstance(obj, (System.Guid, str)):
        try:
            gid = System.Guid(obj) if isinstance(obj, str) else obj
        except:
            error("Invalid GUID input.")
        breps = convert_guids_to_breps([gid])
        if not breps:
            error("GUID conversion returned no Brep.")
        msh = geometry_to_mesh(breps[0])
    else:
        msh = geometry_to_mesh(obj)
    V, F = rhino_mesh_to_arrays(msh)
    sender_meshes.append(msh)
    sender_meshes_np.append((name, V, F))

if len(sender_meshes_np) < 1:
    warn("Need at least one surface.")

receiver_meshes = []
receiver_meshes_np = []
for obj, name in zip(_receiver, _receiver_name):
    if obj is None:
        warn("Null geometry skipped.")
        continue
    if isinstance(obj, (System.Guid, str)):
        try:
            gid = System.Guid(obj) if isinstance(obj, str) else obj
        except:
            error("Invalid GUID input.")
        breps = convert_guids_to_breps([gid])
        if not breps:
            error("GUID conversion returned no Brep.")
        msh = geometry_to_mesh(breps[0])
    else:
        msh = geometry_to_mesh(obj)
    V, F = rhino_mesh_to_arrays(msh)
    receiver_meshes.append(msh)
    receiver_meshes_np.append((name, V, F))

if len(receiver_meshes_np) < 1:
    warn("Need at least one surface.")

if run:
    vf_result = view_factor(
        sender=sender_meshes_np,
        receiver=receiver_meshes_np,
        samples=_samples,
        rays=_rays,
        seed=_seed,
        gpu_threads=_gpu_threads,
        use_bvh=_use_bvh,
        flip_faces=_flip_faces,
        max_iters=_max_iters,
        tol=_tol

    )
    vf_matrix = [vf_result]
# ---------- end raystrack ----------
compas_version = Panel(unload.out)
panel_3 = Panel(raystrackmatrix.out)
panel_4 = Panel("Top")
readviewfactormatrix = Python3Script(vf_matrix=raystrackmatrix.vf_matrix, sender="Bottom", receiver="Top")  # -> out, view_factor; inputs vf_matrix: list
# ---------- readviewfactormatrix: Python ----------
import Rhino, ghpythonlib

def vf_lookup(matrix, sender, receiver=None):
    # 1) flatten list-of-dicts if needed
    if isinstance(matrix, list):
        flat = {}
        for d in matrix:
            if not isinstance(d, dict):
                raise TypeError("All elements of _vf_matrix list must be dicts")
            flat.update(d)
    elif isinstance(matrix, dict):
        flat = matrix
    else:
        raise TypeError("_vf_matrix must be a dict or list of dicts")

    # 2) get the row for sender
    try:
        row = flat[sender]
    except KeyError:
        raise KeyError(f"Sender '{sender}' not found in the VF matrix")

    # 3) pick the right key
    if receiver:
        for key, val in row.items():
            # match if receiver substring is in the key
            if receiver in key:
                print(f"{key}: {float(val)}")
                return float(val)

        raise KeyError(f"No entry containing '{receiver}' in row for '{sender}'")
    else:
        row_dict = [row]
        print(row)
        return row_dict

view_factor = vf_lookup(_vf_matrix, _sender, _receiver)
# ---------- end readviewfactormatrix ----------
readviewfactormatrix_2 = Python3Script(vf_matrix=raystrackmatrix.vf_matrix, sender="Top", receiver="Bottom")  # -> out, view_factor; inputs vf_matrix: list; same code as readviewfactormatrix
readviewfactormatrix_3 = Python3Script(vf_matrix=raystrack.vf_matrix, sender="Bottom")  # -> out, view_factor; inputs vf_matrix: list; same code as readviewfactormatrix
panel_5 = Panel(readviewfactormatrix.out)
subtraction = Subtraction(A=readviewfactormatrix.view_factor, B=readviewfactormatrix_2.view_factor)
panel_6 = Panel(readviewfactormatrix_2.out)
panel_7 = Panel(readviewfactormatrix_3.out)
panel_8 = Panel(subtraction)
